# Grasshopper definition 7_bar_truss_example.gh (Grasshopper 0.9.76)
# plug-ins: Capture, Writer, MOO, Sampler

# ----
# Variables
height = Slider(4.501, range=-10..10)
width = Slider(0.465, range=0..5)

# ----
# Sampler
directory = Panel("C:\Code\gh-design-space-exploration\Sampler\bin\")
sampler = Sampler(
    Variables=[height, width],
    Samples=Slider(100, range=0..100),
    Type=2,
    Seed=Slider(0, range=0..10),
    Filename="7_bar_truss",
    Directory=directory)
panel = Panel(sampler)

# ----
# Geometry
panel_2 = Panel("10")
neg = Negative(Value=width)
pt = ConstructPoint(XCoordinate=0, YCoordinate=0, ZCoordinate=0)
pt_2 = ConstructPoint(XCoordinate=panel_2, YCoordinate=0, ZCoordinate=0)
vec = VectorXYZ(XComponent=width, YComponent=height, ZComponent=0)  # -> Vector, Length
vec_2 = VectorXYZ(XComponent=neg, YComponent=height, ZComponent=0)  # -> Vector, Length
division = Division(A=panel_2, B=2)
pt_3 = ConstructPoint(XCoordinate=division, YCoordinate=0, ZCoordinate=0)
move = Move(Geometry=pt_3, Motion=vec_2.Vector)  # -> Geometry, Transform
move_2 = Move(Geometry=pt_3, Motion=vec.Vector)  # -> Geometry, Transform
ln = Line(StartPoint=pt_2, EndPoint=move_2.Geometry)
ln_2 = Line(StartPoint=move_2.Geometry, EndPoint=move.Geometry)
ln_3 = Line(StartPoint=pt_3, EndPoint=move.Geometry)
ln_4 = Line(StartPoint=pt_3, EndPoint=move_2.Geometry)
ln_5 = Line(StartPoint=pt_2, EndPoint=pt_3)
ln_6 = Line(StartPoint=move.Geometry, EndPoint=pt)
ln_7 = Line(StartPoint=pt, EndPoint=pt_3)

pipe = Pipe(Curve=[ln_3, ln_4, ln_5, ln_6, ln_7, ln_2, ln], Radius=0.25, Caps=0)
abs = Absolute(Value=height)

# ----
# Evaluations
boundary = BoundarySurfaces(Edges=[ln_5, ln_6, ln_7, ln_2, ln])
area = Area(Geometry=boundary)  # -> Area, Centroid
neg_2 = Negative(Value=abs)

# ----
# Properties
len = Length(Curve=[ln_3, ln_4, ln_5, ln_6, ln_7, ln_2])
ma = MassAddition(Input=len)  # -> Result, PartialResults
length_of_all_members = Number(ma.Result)

# ----
# Objectives
depth_negative_for_opt = Number(neg_2)
profile_area = Number(area.Area)

# ----
# Capture
panel_3 = Panel("truss_screenshot")

capture = Capture(
    Variables=[height, width],
    Objectives=[profile_area, depth_negative_for_opt],
    Mode=0,
    Properties=length_of_all_members,
    DesignMap=panel,
    CsvFilename="truss_data",
    CsvDirectory=directory,
    ScreenshotFilename=panel_3,
    ScreenshotDirectory=directory)  # -> DesignMapObjectives, CapturedProperties

panel_4 = Panel(capture.CapturedProperties)
panel_5 = Panel(capture.DesignMapObjectives)

# ----
# MOO
number_slider = Slider(100, range=0..100)

moo = MOO(
    Variables=[height, width],
    Objectives=[profile_area, depth_negative_for_opt],
    PopulationSize=Slider(20, range=0..100),
    MaxEvaluations=number_slider,
    Filename="truss_MOO.csv",
    Directory=directory)  # -> ParetoFront, AllSolutions

panel_6 = Panel(moo.ParetoFront)
panel_7 = Panel(moo.AllSolutions)
item = ListItem(List=panel_6, Index=2, Wrap=True)  # -> flatten(Item)
item_2 = ListItem(List=panel_6, Index=3, Wrap=True)  # -> flatten(Item)

# ----
# Writer
directory_2 = Panel("C:\Code\gh-design-space-exploration\Sampler\bin\MOO-Pareto.csv")
writer = Writer(Data=moo.ParetoFront, Filepath=directory_2)
