# Grasshopper definition Effects-test.gh (Grasshopper 0.9.76)
# plug-ins: Effects

number_slider = Slider(1, range=0..1)
number_slider_2 = Slider(1, range=0..3)
number_slider_3 = Slider(1, range=0..1)
panel = Panel("""0.33
0.50
0.66""")
ma = MassAddition(Input=[number_slider_3, number_slider_2, number_slider])  # -> Result, PartialResults
panel_2 = Panel("""0     0     0     0
     0     1     1     1
     0     2     2     2
     1     0     1     2
     1     1     2     0
     1     2     0     1
     2     0     2     1
     2     1     0     2
     2     2     1     0""")
effects = Effects(Variables=[number_slider_3, number_slider_2, number_slider], Objectives=ma.Result, Levels=2, LevelSettings=panel)  # -> AverageEffects, RawEffects
panel_3 = Panel(effects.AverageEffects)
