# Grasshopper definition cluster-test.gh (Grasshopper 0.9.76)
# plug-ins: Cluster, Writer, Sampler

number_slider = Slider(4, range=1..10)
number_slider_2 = Slider(4, range=1..10)
number_slider_3 = Slider(4, range=1..10)
panel = Panel("C:\Code\gh-design-space-exploration\Sampler\bin\CLUSTERTEST")
sampler = Sampler(
    Variables=[number_slider, number_slider_2, number_slider_3],
    Samples="100",
    Type=0,
    Seed="0",
    Filename="test-01",
    Directory="C:\Code\gh-design-space-exploration\Sampler\bin\")
panel_2 = Panel(sampler)
number_slider_4 = Slider(0, range=0..10)
writer = Writer(Data=panel_2, Filepath=panel)
cluster = Cluster(
    Variables=[number_slider, number_slider_2, number_slider_3],
    DesignMap=panel_2,
    NumberOfClusters=Slider(3, range=0..10),
    Flexibility=Slider(1, range=0..10))  # -> ClusterList, ClusterAvs, ClusterMins, ClusterMaxs, ClusterObjs
panel_3 = Panel(cluster.ClusterList)
