# Grasshopper definition diversity-test.gh (Grasshopper 0.9.76)
# plug-ins: Sampler, Diversity

sampler = Sampler(
    Variables=[Slider(4, range=1..10), Slider(4, range=1..10)],
    Samples="10",
    Type=0,
    Seed="3",
    Filename="test-01",
    Directory="C:\Code\gh-design-space-exploration\Sampler\bin")
panel = Panel(sampler)
item = ListItem(List=panel, Index=1, Wrap=True)
diversity = Diversity(DesignMap=panel, Mode=0)  # -> Diversity, Test
panel_2 = Panel(item)
panel_3 = Panel(diversity.Test)
