# Grasshopper definition sift-test.gh (Grasshopper 0.9.76)
# plug-ins: Sift, Sampler

number_slider = Slider(4, range=1..10)
number_slider_2 = Slider(4, range=1..10)
number_slider_3 = Slider(4, range=1..10)
sampler = Sampler(
    Variables=[number_slider, number_slider_2, number_slider_3],
    Samples="100",
    Type=0,
    Seed="0",
    Filename="test-01",
    Directory="C:\Code\gh-design-space-exploration\Sampler\bin")
sift = Sift(Variables=[number_slider, number_slider_2, number_slider_3], DesignMap=sampler, Index=Slider(2, range=0..10))
panel = Panel(sift)
panel_2 = Panel(sampler)
box = CenterBox(Base=PlaneXY(0, 0, 0), X=number_slider, Y=number_slider_2, Z=number_slider_3)
